# Grasshopper definition grasshopper.gh (Grasshopper 1.0.7)

# Square Shape
number_slider = Slider(5, range=0..7)
number_slider_2 = Slider(8, range=0..10)
# Hexagon Shape
number_slider_3 = Slider(5, range=0..7)
number_slider_4 = Slider(8, range=0..10)
number_slider_5 = Slider(20, range=0..50)
number_slider_6 = Slider(20, range=0..50)
division = Division(A=number_slider, B=-2)
division_2 = Division(A=number_slider_3, B=-2)
# rectangle cutouts
rectangle = Rectangle(Plane=PlaneXY(0, 0, 0), XSize=number_slider, YSize=number_slider_2, Radius=0)  # -> Rectangle, Length
rectangle_2 = Rectangle(Plane=PlaneXY(0, 0, 0), XSize=number_slider_3, YSize=number_slider_4, Radius=0)  # -> Rectangle, Length
subtraction = Subtraction(A=number_slider_5, B=number_slider_2)
subtraction_2 = Subtraction(A=number_slider_6, B=number_slider_4)
# making the hexagon shape
number_slider_7 = Slider(6.508, range=0..50)
# making the square shape
polygon = Polygon(Plane=PlaneXY(0, 0, 0), Radius=number_slider_5, Segments=Slider(4, range=0..50), FilletRadius=0)  # -> Polygon, Length
polygon_2 = Polygon(Plane=PlaneXY(0, 0, 0), Radius=number_slider_6, Segments=Slider(6, range=0..50), FilletRadius=0)  # -> Polygon, Length
vector_xyz = VectorXYZ(XComponent=division, YComponent=subtraction, ZComponent=0)  # -> Vector, Length
move = Move(Geometry=rectangle.Rectangle, Motion=vector_xyz.Vector)  # -> Geometry, Transform
vector_xyz_2 = VectorXYZ(XComponent=division_2, YComponent=subtraction_2, ZComponent=0)  # -> Vector, Length
move_2 = Move(Geometry=rectangle_2.Rectangle, Motion=vector_xyz_2.Vector)  # -> Geometry, Transform
# creating the 3D shape that can be variable
vector_xyz_3 = VectorXYZ(XComponent=0, YComponent=0, ZComponent=number_slider_7)  # -> Vector, Length
# creating the 3D shape that can be variable
number_slider_8 = Slider(6.508, range=0..50)
surface = Surface(polygon_2.Polygon)
polar_array = PolarArray(Geometry=move.Geometry, Plane=PlaneXY(0, 0, 0), Count=Slider(4, range=0..7), Angle=6.283185307)  # -> Geometry, Transform
# baking for 3d shape
extrude = Extrude(Base=surface, Direction=vector_xyz_3.Vector)
polar_array_2 = PolarArray(Geometry=move_2.Geometry, Plane=PlaneXY(0, 0, 0), Count=Slider(4, range=0..7), Angle=6.283185307)  # -> Geometry, Transform
vector_xyz_4 = VectorXYZ(XComponent=0, YComponent=0, ZComponent=number_slider_8)  # -> Vector, Length
surface_2 = Surface(polygon.Polygon)
trim_with_regions = TrimWithRegions(Curve=polygon.Polygon, Regions=polar_array.Geometry)  # -> Inside, Outside
# trimming the desired shape
trim_with_regions_2 = TrimWithRegions(Curve=polar_array.Geometry, Regions=polygon.Polygon)  # -> flatten(Inside), Outside
trim_with_regions_3 = TrimWithRegions(Curve=polygon_2.Polygon, Regions=polar_array_2.Geometry)  # -> Inside, Outside
# trimming the desired shape
trim_with_regions_4 = TrimWithRegions(Curve=polar_array_2.Geometry, Regions=polygon_2.Polygon)  # -> flatten(Inside), Outside
# baking for 3d shape
extrude_2 = Extrude(Base=surface_2, Direction=vector_xyz_4.Vector)
# baking after joining
join_curves = JoinCurves(Curves=[trim_with_regions.Outside, trim_with_regions_2.Inside], Preserve=False)
# baking after joining
join_curves_2 = JoinCurves(Curves=[trim_with_regions_3.Outside, trim_with_regions_4.Inside], Preserve=False)
